# Grasshopper definition rigid_brep_panels.gh (Grasshopper 1.0.4)

polygon = Polygon(Plane=PlaneXY(0, 0, 0), Radius="4.5", Segments="3", FilletRadius=0)  # -> Polygon, Length
cir = Circle(Plane=PlaneXY(0, 0, 0), Radius="4")
number_slider = Slider(5, range=0..10)
rectangle = Rectangle(Plane=PlaneXY(0, 0, 0), XSize="8", YSize="8", Radius=0)  # -> Rectangle, Length
explode = Explode(Curve=polygon.Polygon, Recursive=True)  # -> Segments, Vertices
srf = Surface(polygon.Polygon)
divide = DivideCurve(Curve=cir, Count="5", Kinks=False)  # -> Points, Tangents, Parameters
boxrec = BoxRectangle(Rectangle=rectangle.Rectangle, Height="8")
number_slider_2 = Slider(7, range=0..10)
rectangle_2 = Rectangle(Plane=PlaneXY(0, 0, 0), XSize=number_slider, YSize=number_slider, Radius=0)  # -> Rectangle, Length
split = SplitList(List=explode.Vertices, Index="2")  # -> ListA, ListB
avr = Average(Input=explode.Vertices)
shatter = Shatter(Curve=cir, Parameters=divide.Parameters)
number_slider_3 = Slider(0.8, range=0..1)
dispatch = Dispatch(List=split.ListA, DispatchPattern=[True, False])  # -> ListA, ListB
boxrec_2 = BoxRectangle(Rectangle=rectangle_2.Rectangle, Height=Slider(36, range=0..100))
lng = ListLength(List=shatter)
dist = Distance(PointA=dispatch.ListA, PointB=dispatch.ListB)
series = Series(Start="1", Step="0", Count=number_slider_2)
round_brep = CSharpScript(brep=boxrec, radius="1")  # -> breps; inputs brep: Brep, radius: Double
# ---------- round_brep: C# ----------
    int numOfEdges = brep.Edges.Count;

    int[] indexes = new int[numOfEdges];
    double[] radiusList = new double[numOfEdges];

    for (var i = 0; i < numOfEdges; i++) {
      indexes[i] = i;
      radiusList[i] = radius;
    }

    breps = Rhino.Geometry.Brep.CreateFilletEdges(brep, indexes, radiusList, radiusList, Rhino.Geometry.BlendType.Fillet, Rhino.Geometry.RailType.RollingBall, 0.001);
# ---------- end round_brep ----------
scale = Scale(Geometry=boxrec_2, Center=Point(0, 0, 0), Factor=series)  # -> Geometry, Transform
pt = ConstructPoint(XCoordinate=0, YCoordinate=0, ZCoordinate=0)
series_2 = Series(Start=number_slider_3, Step=number_slider_3, Count=lng)
python = GhPythonScript(x=dist)  # -> y
# ---------- python: Python ----------
__author__ = "ytakzk"
__version__ = "2019.05.16"

import math

y = x * math.sqrt(3) / 2
# ---------- end python ----------
extr = ExtrudePoint(Base=shatter, Point=pt)
Z = UnitZ(Factor=python)
Z_2 = UnitZ(Factor=series_2)
split_2 = SplitList(List=scale.Geometry, Index="1")  # -> ListA, ListB
move = Move(Geometry=avr, Motion=Z)  # -> Geometry, Transform
box = Box(split_2.ListB)
neg = Negative(Value=Slider(0.5, range=0.1..3))
lng_2 = ListLength(List=box)
move_2 = Move(Geometry=extr, Motion=Z_2)  # -> Geometry, Transform
series_3 = Series(Start=Slider(10, range=1..10), Step=Slider(2, range=1..10), Count=number_slider_2)
series_4 = Series(Start="4", Step=neg, Count=lng_2)
extr_2 = ExtrudePoint(Base=srf, Point=move.Geometry)
python_2 = GhPythonScript(brep=round_brep, scaleX=Slider(2.1, range=1..5), scaleY=Slider(1.2, range=1..3), scaleZ="0.99")  # -> breps, center; inputs brep: Brep
# ---------- python_2: Python ----------
__author__ = "ytakzk"
__version__ = "2019.05.16"

import Rhino.Geometry as rg

box = brep.GetBoundingBox(rg.Plane.WorldXY)

center = box.Center

plane = rg.Plane(center, rg.Plane.WorldXY.ZAxis)

transform = rg.Transform.Scale(plane, scaleX, scaleY, scaleZ)

box.Transform(transform)

brep_box = box.ToBrep()

breps = rg.Brep.CreateBooleanDifference(brep_box, brep, 0.001)
# ---------- end python_2 ----------
merge = Merge(Data1=simplify(graft(extr)), Data2=simplify(graft(move_2.Geometry)))
vec = VectorXYZ(XComponent=series_4, YComponent=series_4, ZComponent=series_3)  # -> Vector, Length
move_3 = Move(Geometry=box, Motion=vec.Vector)  # -> Geometry, Transform
loft = Loft(Curves=merge, Options={Adjust=False, Closed=False, LoftEnds=0, LoftSimp=0, LoftType=0, Rebuild=10, Refit=0.01})  # -> flatten(Loft)
box_2 = Box(split_2.ListA)
bbox = BoundingBox(Content=extr_2, Plane=PlaneXY(0, 0, 0))  # -> Box, Box_2
yz = YZPlane(Origin=python_2.center)
sunion = SolidUnion(Breps=move_3.Geometry)
cap = CapHoles(Brep=loft)
boxprop = BoxProperties(Box=bbox.Box)  # -> Center, Diagonal, Area, Volume, Degeneracy
rotate = Rotate(Geometry=yz, Angle=degrees("45"), Plane=python_2.center)  # -> Geometry, Transform
sdiff = SolidDifference(BrepsA=box_2, BrepsB=sunion)
sunion_2 = SolidUnion(Breps=cap)
cir_2 = Circle(Plane=rotate.Geometry, Radius="100")
srf_2 = Surface(cir_2)
scale_nu = ScaleNU(
    Geometry=bbox.Box,
    Plane=boxprop.Center,
    ScaleX=Slider(2.1, range=1..5),
    ScaleY=Slider(1.2, range=1..3),
    ScaleZ="0.9999999")  # -> Geometry, Transform
python_3 = GhPythonScript(
    brep=sunion_2,
    scaleX=Slider(2.1, range=1..5),
    scaleY=Slider(1.2, range=1..3),
    scaleZ="0.99",
    z_positive_diff=number_slider_3)  # -> breps, center; inputs brep: Brep; same code as python_2
python_4 = GhPythonScript(brep=sdiff, scaleX=Slider(2, range=1..5), scaleY=Slider(2, range=1..3), scaleZ="0.99")  # -> breps, center; inputs brep: Brep; same code as python_2
split_3 = SplitBrep(Brep=python_2.breps, Cutter=srf_2)
sdiff_2 = SolidDifference(BrepsA=scale_nu.Geometry, BrepsB=extr_2)
dispatch_2 = Dispatch(List=split_3, DispatchPattern=[True, False])  # -> ListA, ListB
X = UnitX(Factor=Slider(-3, range=-10..10))
yz_2 = YZPlane(Origin=python_3.center)
yz_3 = YZPlane(Origin=python_4.center)
move_4 = Move(Geometry=dispatch_2.ListB, Motion=X)  # -> Geometry, Transform
rotate_2 = Rotate(Geometry=yz_2, Angle=degrees("20"), Plane=python_3.center)  # -> Geometry, Transform
rotate_3 = Rotate(Geometry=yz_3, Angle=degrees(Slider(0, range=0..90)), Plane=python_4.center)  # -> Geometry, Transform
round_brep_2 = CSharpScript(brep=sdiff_2, radius="0.3")  # -> breps; inputs brep: Brep, radius: Double; same code as round_brep
merge_2 = Merge(Data1=dispatch_2.ListA, Data2=move_4.Geometry)
cir_3 = Circle(Plane=rotate_2.Geometry, Radius="100")
cir_4 = Circle(Plane=rotate_3.Geometry, Radius="100")
srf_3 = Surface(cir_3)
srf_4 = Surface(cir_4)
yz_4 = YZPlane(Origin=Point(0, 0, 0))
split_4 = SplitBrep(Brep=python_3.breps, Cutter=srf_3)
rotate_4 = Rotate(Geometry=yz_4, Angle=degrees("40"), Plane=PlaneXY(0, 0, 0))  # -> Geometry, Transform
split_5 = SplitBrep(Brep=python_4.breps, Cutter=srf_4)
dispatch_3 = Dispatch(List=split_4, DispatchPattern=[True, False])  # -> ListA, ListB
dispatch_4 = Dispatch(List=split_5, DispatchPattern=[True, False])  # -> ListA, ListB
X_2 = UnitX(Factor=Slider(-3, range=-10..10))
X_3 = UnitX(Factor=Slider(10, range=-10..10))
move_5 = Move(Geometry=rotate_4.Geometry, Motion=boxprop.Center)  # -> Geometry, Transform
move_6 = Move(Geometry=dispatch_3.ListB, Motion=X_2)  # -> Geometry, Transform
move_7 = Move(Geometry=dispatch_4.ListB, Motion=X_3)  # -> Geometry, Transform
cir_5 = Circle(Plane=move_5.Geometry, Radius="100")
merge_3 = Merge(Data1=dispatch_3.ListA, Data2=move_6.Geometry)
srf_5 = Surface(cir_5)
merge_4 = Merge(Data1=dispatch_4.ListA, Data2=move_7.Geometry)
geo = Geometry(merge_2)
split_6 = SplitBrep(Brep=round_brep_2, Cutter=srf_5)
geo_2 = Geometry(merge_3)
geo_3 = Geometry(merge_4)
dispatch_5 = Dispatch(List=split_6, DispatchPattern=[True, False])  # -> ListA, ListB
X_4 = UnitX(Factor=Slider(-3, range=-10..10))
move_8 = Move(Geometry=dispatch_5.ListB, Motion=X_4)  # -> Geometry, Transform
merge_5 = Merge(Data1=dispatch_5.ListA, Data2=move_8.Geometry)
geo_4 = Geometry(merge_5)
