# Grasshopper definition rigid_mesh_panels.gh (Grasshopper 1.0.4)
# plug-ins: Weaverbird

pt = ConstructPoint(XCoordinate=0, YCoordinate=0, ZCoordinate=Slider(20, range=0..20))
pt_2 = ConstructPoint(XCoordinate=0, YCoordinate=0, ZCoordinate=Slider(16, range=5..50))
python = GhPythonScript(name="C:\Users\ytakzk\Desktop\bunny.obj", scale="180")  # -> out, mesh
# ---------- python: Python ----------
__author__ = "ytakzk"
__version__ = "2019.05.11"

import math

class Vertex:
    
    def __init__(self, x, y, z):
        
        self.x = x
        self.y = y
        self.z = z

class Face:
    
    def __init__(self, vertices, indexes):
        
        arr = zip(vertices, indexes)
        self.vertices, self.indexes = zip(*list(sorted(arr, key=lambda v: v[0].z)))
        
    @property
    def max(self):
        
        return self.vertices[-1]
    
    @property
    def min(self):
        
        return self.vertices[0]

    @property
    def max_z(self):
        
        return self.max.z
    
    @property
    def min_z(self):
        
        return self.min.z
    
    def is_contain(self, p):
        
        return p in self.vertices

with open(name, 'r') as f:

    vertices     = []
    faces        = []

    for l in f:
        
        if l.startswith('v '):
            
            d = l.split('  ')
            data = []
            for dd in d:
                data.extend(dd.split(' '))
            x = float(data[1]) * scale
            y = float(data[3]) * scale
            z = float(data[2]) * scale                    

            vertex = Vertex(x, y, z)
            vertices.append(vertex)
            
        
        elif l.startswith('f '):
            
            data = l.replace('\n', '').split(' ')
            data = [d for d in data if d]

            if '/' in data:
                face_indexes = [int(index) - 1 for index in data[1:]]
            else:
                face_indexes = [int(index.split('/')[0]) - 1 for index in data[1:]]
            
            triangles = []
            
            if len(face_indexes) == 3:
                
                triangles.append(face_indexes)
                
            elif len(face_indexes) == 4:
                
                triangles.append(face_indexes[:3])
                triangles.append(face_indexes[2:] + [face_indexes[0]])
            
            else:
                
                raise ValueError('The face contains more than 5 vertices.')
            
            for face_indexes in triangles:

                f_vertices = [vertices[i] for i in face_indexes]

                # discard any triangle that has two or more coincident vertices
                if f_vertices[0] == f_vertices[1] or f_vertices[1] == f_vertices[2] or f_vertices[2] == f_vertices[0]:
                    print('discarded')
                    continue

                face = Face(f_vertices, face_indexes)
                faces.append(face)

    import Rhino.Geometry as rg

    mesh = rg.Mesh()

    for v in vertices:
        mesh.Vertices.Add(v.x, v.y, v.z)

    for f in faces:

        mesh.Faces.AddFace(f.indexes[0], f.indexes[1], f.indexes[2])
# ---------- end python ----------
wbdodecahedron = WeaverbirdsPolylinesDodecahedron(Plane=PlaneXY(0, 0, 0), Radius="8")
wbicosahedron = WeaverbirdsMeshMeshIcosahedron(Plane=PlaneXY(0, 0, 0), Radius="8")
mesh = MeshBrep(
    Brep=wbdodecahedron,
    Settings={GridMaxCount=0, GridMinCount=16, JaggedSeams=False, MaxEdgeLength=0, MinEdgeLength=0.0001, MinTolerance=0, Refine=True, RefineAngle=0, RelativeTolerance=0.65, SimplePlanes=True, Tolerance=0})
wbpyramid = WeaverbirdsMeshPyramid(
    Plane=PlaneXY(0, 0, 0),
    Width=Slider(20, range=0..20),
    NumberOfSides="4",
    TopPoint=pt,
    BasePolygonMethod=True,
    FillStrategy=1)
wbdipyramid = WeaverbirdsMeshDipyramid(Plane=PlaneXY(0, 0, 0), Width=Slider(4, range=4..25), NumberOfSides="3", TopPoint=pt_2, BasePolygonMethod=True)
tri = Triangulate(Mesh=mesh)  # -> Mesh, Count
tri_2 = Triangulate(Mesh=wbpyramid)  # -> Mesh, Count
bbox = BoundingBox(Content=python.mesh, Plane=PlaneXY(0, 0, 0))  # -> Box, Box_2
joint_width = Slider(3, range=0..10)
joint_length = Slider(1, range=0..10)
interval = Slider(47, range=0..100)
weld = WeldMesh(Mesh=tri_2.Mesh, Angle=3.141592654)
list = ValueList({"None": 0, "Triangle": 1, "Rect": 2}, selected="Rect")
number_slider = Slider(30, range=0..30)  # disabled
number_slider_2 = Slider(7, range=0..30)  # disabled
debox = DeconstructBox(Box=bbox.Box)  # -> Plane, X, Y, Z
pt_3 = ConstructPoint(XCoordinate="60", YCoordinate=0, ZCoordinate=0)
number_slider_3 = Slider(30, range=0..30)  # disabled
facen = FaceNormals(Mesh=weld)  # -> Centers, Normals
dedomain = DeconstructDomain(Domain=debox.Z)  # -> Start, End
vdis = VectorDisplay(Anchor=facen.Centers, Vector=facen.Normals)
neg = Negative(Value=dedomain.Start)
panel = Panel("0.1")  # disabled
python_2 = GhPythonScript(
    meshes=mesh,
    thickness=Slider(10, range=0.5..10),
    joint_type=list,
    joint_width=joint_width,
    joint_length=joint_length,
    origin=pt_3,
    interval=interval)  # -> out, rigid_faces, oriented_rigid_faces, tmp; inputs meshes: list of Mesh, joint_type: Int32, origin: Point3d; disabled
# ---------- python_2: Python ----------
import Rhino.Geometry as rg
import math
import sys

sys.path.append('./')

#import face
#reload(face)
#
#import edge
#reload(edge)

import mesh
reload(mesh)

from face import Face
from edge import Edge
from mesh import Mesh

tmp = []
rigid_faces = []
oriented_rigid_faces = []

mesh = Mesh(meshes)

arguments = {
    'thickness': thickness,
    'joint_type': joint_type,
    'interval': interval,
    'origin': origin, 
    'joint_width': joint_width,
    'joint_length': joint_length
    
}

rigid_faces, oriented_rigid_faces = mesh.thinken(**arguments)
# ---------- end python_2 ----------
Z = UnitZ(Factor=neg)
move = Move(Geometry=python.mesh, Motion=Z)  # -> Geometry, Transform
unim = UnifyMesh(Mesh=move.Geometry)  # -> Result, Count
geo = Geometry(python_2.rigid_faces)
geo_2 = Geometry(python_2.oriented_rigid_faces)
geo_3 = Geometry(python_2.tmp)
list_2 = ValueList({"Mono": True, "Colorize": False}, selected="Colorize")
python_3 = GhPythonScript(meshes=move.Geometry)  # -> out, mesh, interface, tmp; inputs meshes: list of Mesh
# ---------- python_3: Python ----------
import Rhino.Geometry as rg
import math
import sys

sys.path.append('./')

import face
reload(face)
#
import edge
reload(edge)

import mesh
reload(mesh)

from face import Face
from edge import Edge
from mesh import Mesh

tmp = []
rigid_faces = []
oriented_rigid_faces = []

mesh = Mesh(meshes)

mesh, interface = mesh.separate()
# ---------- end python_3 ----------
python_4 = GhPythonScript(mesh=python_3.mesh, distance=number_slider)  # -> out, mold_mesh, tmp; inputs mesh: Mesh; disabled
# ---------- python_4: Python ----------
__author__ = "ytakzk"
__version__ = "2019.05.17"

import Rhino.Geometry as rg

mesh.Normals.ComputeNormals()
mesh.Compact()

# normal

normal = rg.Vector3d(0, 0, 0)

for n in mesh.Normals:

    n = rg.Vector3d(n)
    normal += n

normal /= len(mesh.Normals)

# center

center = rg.Vector3d(0, 0, 0)

for v in mesh.Vertices:
    
    center += rg.Vector3d(v)

center /= len(mesh.Vertices)
center = rg.Point3d(center)

plane_center = center + normal * distance
plane = rg.Plane(plane_center, normal)

# project onto the plane

original_vertex_count = len(mesh.Vertices)

projection = rg.Transform.PlanarProjection(plane)

projected_vertices = []
for v in mesh.Vertices:
    
    v = rg.Point3d(v)
    
    v.Transform(projection)
    
    projected_vertices.append(v)

    mesh.Vertices.Add(v)

for e in range(mesh.TopologyEdges.Count):

    pair = mesh.TopologyEdges.GetTopologyVertices(e)
    
    index1 = pair.I
    index2 = pair.J
    
    index3 = original_vertex_count + index1
    index4 = original_vertex_count + index2
    
    mesh.Faces.AddFace(index1, index2, index4, index3)
#    mesh.Faces.AddFace(index3, index4, len(mesh.Vertices) - 1)

mesh.Compact()

mold_mesh = mesh

tmp = projected_vertices
# ---------- end python_4 ----------
mesh_2 = Mesh(python_4.mold_mesh)  # disabled
python_5 = GhPythonScript(mesh=python_3.mesh, distance=number_slider_2)  # -> out, breps, tmp; inputs mesh: Mesh; disabled
# ---------- python_5: Python ----------
__author__ = "ytakzk"
__version__ = "2019.05.17"

import Rhino.Geometry as rg

mesh.Normals.ComputeNormals()
mesh.Compact()

# normal

normal = rg.Vector3d(0, 0, 0)

for n in mesh.Normals:

    n = rg.Vector3d(n)
    normal += n

normal /= len(mesh.Normals)

# center

center = rg.Vector3d(0, 0, 0)

for v in mesh.Vertices:
    
    center += rg.Vector3d(v)

center /= len(mesh.Vertices)
center = rg.Point3d(center)

vector = normal * distance * 2

breps = []

surface = rg.Brep.CreateFromMesh(mesh, True)
tmp = []
for f in surface.Faces:

#    p1 = f.PointAt(0.5, 0.5)
#    p2 = p1 + vector
#    curve = rg.Line(p1, p2).ToNurbsCurve()
#    brep = f.CreateExtrusion(curve, True)
#    a = brep.CapPlanarHoles(0.01)
#    breps.append(brep)

    pts = []
    for edge_index in f.AdjacentEdges():
        pts.append(surface.Edges[edge_index].PointAtStart)
        pts.append(surface.Edges[edge_index].PointAtEnd)
        
    pts = list(set(pts))

    polyline = rg.Polyline(pts).ToNurbsCurve()

    brep = rg.Surface.CreateExtrusion(polyline, vector).ToBrep()

    breps.append(brep)
# ---------- end python_5 ----------
python_6 = GhPythonScript(mesh=python_3.mesh, distance=number_slider_3)  # -> out, mold_mesh, tmp; inputs mesh: Mesh; disabled
# ---------- python_6: Python ----------
__author__ = "ytakzk"
__version__ = "2019.05.17"

import Rhino.Geometry as rg

mesh.Normals.ComputeNormals()
mesh.Compact()

# normal

normal = rg.Vector3d(0, 0, 0)

for n in mesh.Normals:

    n = rg.Vector3d(n)
    normal += n

normal /= len(mesh.Normals)

# center

center = rg.Vector3d(0, 0, 0)

for v in mesh.Vertices:
    
    center += rg.Vector3d(v)

center /= len(mesh.Vertices)
center = rg.Point3d(center)

plane_center = center + normal * distance
plane = rg.Plane(plane_center, normal)

# get points along the naked edge

naked_indexes = {}

for i, is_naked in enumerate(mesh.GetNakedEdgePointStatus()):
    
    if is_naked:
        naked_indexes[mesh.Vertices[i]] = i

naked_index_path = []

for point in mesh.GetNakedEdges()[0]:
    
    for k in naked_indexes.keys():
        
        if rg.Point3d(k).DistanceTo(point) < 0.01:
            
            naked_index_path.append(naked_indexes[k])
            break

# project onto the plane

original_vertex_count = len(mesh.Vertices)

projection = rg.Transform.PlanarProjection(plane)

projected_vertices = []
for i in naked_index_path:
    
    v = rg.Point3d(mesh.Vertices[i])
    
    v.Transform(projection)
    
    projected_vertices.append(v)

    mesh.Vertices.Add(v)

outmost_center = center + normal * distance * 1.5
mesh.Vertices.Add(outmost_center)

for i in range(len(naked_index_path) - 1):
    
    index1 = naked_index_path[i]
    index2 = naked_index_path[(i + 1) % len(naked_index_path)]
    
    index3 = original_vertex_count + i
    index4 = (original_vertex_count + i + 1)
    
    mesh.Faces.AddFace(index1, index2, index4, index3)
    mesh.Faces.AddFace(index3, index4, len(mesh.Vertices) - 1)

mold_mesh = mesh

tmp = projected_vertices
# ---------- end python_6 ----------
geo_4 = Geometry(python_5.breps)  # disabled
mesh_3 = Mesh(python_6.mold_mesh)  # disabled
area = Area(Geometry=geo)  # -> Area, Centroid
lng = ListLength(List=area.Centroid)
handle_thickness = Slider(10, range=0..10)
series = Series(Start=0, Step=1, Count=lng)
avr = Average(Input=python_3.interface)
python_7 = GhPythonScript(mesh=python_3.mesh, interface_center=avr)  # -> out, new_mesh; inputs mesh: Mesh, interface_center: Point3d; disabled
# ---------- python_7: Python ----------
__author__ = "ytakzk"
__version__ = "2019.05.19"


import Rhino.Geometry as rg

mesh = mesh.DuplicateMesh()

mesh.Normals.ComputeNormals()
mesh.Compact()


# normal

normal = rg.Vector3d(0, 0, 0)

for n in mesh.Normals:

    n = rg.Vector3d(n)
    normal += n

normal /= len(mesh.Normals)

normal.Unitize()
normal *= distance

# furthest point

farthest_face_index = 0
farthest_distance   = 0

for i, f in enumerate(mesh.Faces):

    center = mesh.Vertices[f.A] + mesh.Vertices[f.B] + mesh.Vertices[f.C]
    center = rg.Point3d(center) / 3
    
    dist = center.DistanceTo(interface_center)
    
    if farthest_distance < dist:
        
        farthest_face_index = i
        farthest_distance   = center

last_length = len(mesh.Vertices)

farthest_face = mesh.Faces[farthest_face_index]
for i in [farthest_face.A, farthest_face.B, farthest_face.C]:
    
    pt = rg.Point3d(mesh.Vertices[i])
    pt = pt + normal
    mesh.Vertices.Add(pt)

mesh.Faces.AddFace(farthest_face.A, farthest_face.B, last_length + 1, last_length)
mesh.Faces.AddFace(farthest_face.B, farthest_face.C, last_length + 2, last_length + 1)
mesh.Faces.AddFace(farthest_face.C, farthest_face.A, last_length, last_length + 2)
mesh.Faces.AddFace(last_length, last_length + 1, last_length + 2)

mesh.Normals.ComputeNormals()
mesh.Compact()

new_mesh = mesh
# ---------- end python_7 ----------
wbthicken = WeaverbirdsMeshThicken(MeshCurves=python_7.new_mesh, Distance=panel, OffsetType=0)  # -> flatten(OutputMeshCurves); disabled
disjoint = DisjointMesh(Mesh=wbthicken)  # -> flatten(Meshes); disabled
weld_2 = WeldMesh(Mesh=wbthicken, Angle=3.141592654)  # disabled
tag = TextTag(Location=area.Centroid, Text=series, Colour=ColourSwatch(SwatchColor=RGBA(255, 255, 255, 137)))
python_8 = GhPythonScript(mesh=python_3.mesh, interface_center=avr, normal_thickness=Slider(2, range=0..10), handle_thickness=handle_thickness)  # -> out, new_mesh; inputs mesh: Mesh, interface_center: Point3d
# ---------- python_8: Python ----------
__author__ = "ytakzk"
__version__ = "2019.05.19"


import Rhino.Geometry as rg

mesh = mesh.DuplicateMesh()

mesh.Normals.ComputeNormals()
mesh.Compact()

# furthest point

farthest_face = 0
farthest_distance   = 0

for i, f in enumerate(mesh.Faces):

    center = mesh.Vertices[f.A] + mesh.Vertices[f.B] + mesh.Vertices[f.C]
    center = rg.Point3d(center) / 3
    
    dist = center.DistanceTo(interface_center)
    
    if farthest_distance < dist:
        
        farthest_face = f
        farthest_distance   = center


# outerpoints

vertex_normal_dic = {}

for f in mesh.Faces:
    
    v1 = rg.Vector3d(mesh.Vertices[f.B]) - rg.Vector3d(mesh.Vertices[f.A])
    v2 = rg.Vector3d(mesh.Vertices[f.C]) - rg.Vector3d(mesh.Vertices[f.A])
    
    normal = rg.Vector3d.CrossProduct(v1, v2)
    normal.Unitize()
    
    for i in [f.A, f.B, f.C]:
    
        if not i in vertex_normal_dic:
            vertex_normal_dic[i] = []

    vertex_normal_dic[f.A].append(normal)
    vertex_normal_dic[f.B].append(normal)
    vertex_normal_dic[f.C].append(normal)

vector_by_vertex = {}

for i in vertex_normal_dic:
    
    vec = rg.Vector3d(0, 0, 0)
    
    for v in vertex_normal_dic[i]:
        
        vec += v
    
    vec /= len(vertex_normal_dic)
    vec.Unitize()
    
    vector_by_vertex[i] = vec

# append faces

original_length = len(mesh.Vertices)
original_faces  = list(mesh.Faces)

naked_vertex_status = mesh.GetNakedEdgePointStatus()

for i in vector_by_vertex:
    
    vector = vector_by_vertex[i]
    
    if i in [farthest_face.A, farthest_face.B, farthest_face.C]:
    
        vector *= handle_thickness
        
    else:
        
        vector *= normal_thickness
    
    out_pt = rg.Point3d(mesh.Vertices[i]) + vector
    
    mesh.Vertices.Add(out_pt)

for f in original_faces:
    
    edge_sets = [(f.A, f.B), (f.B, f.C), (f.C, f.A)]
    
    for edge in edge_sets:
        
        e1 = edge[0]
        e2 = edge[1]

        if naked_vertex_status[e1] and naked_vertex_status[e2]:
            
            mesh.Faces.AddFace(e1, e2, original_length + e2, original_length + e1)
        
        mesh.Faces.AddFace(original_length + f.A, original_length + f.B, original_length + f.C)

mesh.Normals.ComputeNormals()
mesh.Compact()

new_mesh = mesh
# ---------- end python_8 ----------
dispatch = Dispatch(List=flatten(python_8.new_mesh), DispatchPattern=list_2)  # -> ListA, ListB
mesh_4 = Mesh(dispatch.ListA)
mesh_5 = Mesh(dispatch.ListB)
preview = CustomPreview(
    Geometry=[geo_2, mesh_4],
    Material={diffuse=RGB(0, 0, 128), emission=RGB(128, 128, 0), shine=0.5, specular=RGB(255, 255, 255), transparency=0.6})
lng_2 = ListLength(List=mesh_5)
series_2 = Series(Start=0, Step=1, Count=lng_2)
gradient = Gradient(
    LowerLimit="0",
    UpperLimit=lng_2,
    Parameter=series_2,
    stops=[0: RGB(243, 57, 0), 0.1: RGB(236, 27, 60), 0.3: RGB(103, 0, 120), 0.4: RGB(39, 72, 161), 0.5: RGB(1, 192, 229), 0.6: RGB(18, 178, 90), 0.7: RGB(79, 186, 8), 0.8: RGB(220, 237, 32), 0.9: RGB(247, 159, 20), 1: RGB(243, 57, 0)])
python_9 = GhPythonScript()  # -> out, a; inputs x: list
# ---------- python_9: Python ----------
__author__ = "ytakzk"
__version__ = "2019.05.08"

a = [
    x[0],
    x[3],
    x[6],
    x[1],
    x[4],
    x[7],
    x[2],
    x[5]
]
# ---------- end python_9 ----------
material = CreateMaterial(Diffuse=gradient, Specular=gradient, Emission=gradient, Transparency="0.7", Shine=0)
preview_2 = CustomPreview(Geometry=mesh_5, Material=material)
joint_width_2 = Slider(3, range=0..10)  # disabled
joint_length_2 = Slider(1, range=0..10)  # disabled
number_slider_4 = Slider(10, range=0.5..10)  # disabled
interval_2 = Slider(47, range=0..100)  # disabled
list_3 = ValueList({"None": 0, "Triangle": 1, "Rect": 2}, selected="Rect")  # disabled
pt_4 = ConstructPoint(XCoordinate=0, YCoordinate=0, ZCoordinate=0)  # disabled
python_10 = GhPythonScript(
    thickness=number_slider_4,
    joint_type=list_3,
    joint_width=joint_width_2,
    joint_length=joint_length_2,
    origin=pt_4,
    interval=interval_2)  # -> out, rigid_faces, oriented_rigid_faces, tmp; inputs meshes: list of Mesh, joint_type: Int32, origin: Point3d; disabled
# ---------- python_10: Python ----------
__author__ = "ytakzk"
__version__ = "2019.05.08"

import Rhino.Geometry as rg
import math

tmp = []
rigid_faces = []
oriented_rigid_faces = []

mesh = rg.Mesh()
for m in meshes:
    mesh.Append(m)

# weld a mesh
mesh.Weld(math.pi)

# triangulate
mesh.Faces.ConvertQuadsToTriangles()

# weld a mesh
mesh.Weld(math.pi)

moved_vertices = {}

class Face():
    
    def __init__(self, f):
        
        self.v1 = f.A
        self.v2 = f.B
        self.v3 = f.C
        
        self.edge = None
    
    @property
    def indexes(self):
        
        return [self.v1, self.v2, self.v3]
        
    @property
    def normal(self):
        
        vec1 = rg.Vector3d(mesh.Vertices[self.v1])
        vec2 = rg.Vector3d(mesh.Vertices[self.v2])
        vec3 = rg.Vector3d(mesh.Vertices[self.v3])
        
        vector1 = vec2 - vec1
        vector2 = vec3 - vec1
        
        vector1.Unitize()
        vector2.Unitize()
        
        normal = rg.Vector3d.CrossProduct(vector1, vector2)
        normal.Unitize()
        
        return normal
    
    def compute_outer_vertices(self):
        
        vertices_sets = []
        
        normal = self.normal
        
        arr = [self.v1, self.v2, self.v3]
        
        for i in range(len(arr)):
            
            v1 = mesh.Vertices[arr[i]]
            v2 = mesh.Vertices[arr[(i + 1) % len(arr)]]
            v3 = mesh.Vertices[arr[i - 1]]
            
            vec1 = rg.Vector3d(v1) - rg.Vector3d(v2)
            vec2 = rg.Vector3d(v1) - rg.Vector3d(v3)
            vec1.Unitize()
            vec2.Unitize()
            
            vec = vec1 + vec2
            vec.Unitize()
            
            pt = rg.Point3d.Add(v1, vec)
            
#            pt += normal
            
            vertices_sets.append((arr[i], pt))
        
        return vertices_sets
        
        # based on normal
#        vertices_sets = []
#        
#        normal = self.normal
#        
#        for i in [self.v1, self.v2, self.v3]:
#            
#            v = mesh.Vertices[i]
#            
#            pt = rg.Point3d(v)
#            
#            pt += normal
#            
#            vertices_sets.append((i, pt))
#        
#        return vertices_sets

class Edge():
    
    def __init__(self, v1, v2):
        
        if v1 < v2:
            self.v1 = v1
            self.v2 = v2
        else:
            self.v1 = v2
            self.v2 = v1
        
        self.faces = []
    
        self.male_created = False
    
    def add_face(self, face):
        
        self.faces.append(face)
        face.edge = self
    
    def __eq__(self, other):
        
        return isinstance(other, Edge) and self.v1 == other.v1 and self.v2 == other.v2
    
    @property
    def key(self):
        
        return self.v1 * 100000 + self.v2
    
    @staticmethod
    def generate_key(v1, v2):
        
        v1, v2 = (v1, v2) if v1 < v2 else (v2, v1)
        
        return v1 * 100000 + v2
    
edges = {}
faces = []
outer_vertices = {}
inner_vertices = {}

for f in mesh.Faces:
    
    if f.C != f.D:
        
        raise ValueError('The input mesh must be a collection of trigonal faces.')
    
    face = Face(f)
    faces.append(face)
    
    for v1, v2 in [(f.A, f.B), (f.B, f.C), (f.C, f.A)]:
        
        edge = Edge(v1, v2)
        key  = edge.key
        
        if not key in edges:
            
            edges[key] = edge
        
        edges[key].add_face(face)
        
        inner_vertices[v1] = mesh.Vertices[v1]
    
    vertices_sets = face.compute_outer_vertices()
    
    for i, v in vertices_sets:
        
        if i in outer_vertices:
            
            outer_vertices[i].append(v)
        
        else:
            
            outer_vertices[i] = [v]

merged_outer_vertices = []

for key in outer_vertices:
    
    points = outer_vertices[key]
    
    inner_point = inner_vertices[key]
    
    x, y, z = 0, 0, 0
    
    for p in points:
        
        x += p.X
        y += p.Y
        z += p.Z
        
    x /= len(points)
    y /= len(points)
    z /= len(points)
    
    point = rg.Point3d(x, y, z)
    
    vector = rg.Vector3d(point) - rg.Vector3d(inner_point)
    vector.Unitize()
    vector *= thickness
    
    new_pt = rg.Point3d.Add(inner_point, vector)
    
    merged_outer_vertices.append(new_pt)
    
#    tmp.append(point)

base_planes = []

for face in faces:
    
    outer_points = []
    inner_points = [] 
    
    for i in face.indexes:
        
        outer_point = merged_outer_vertices[i]
        
        outer_points.append(outer_point)
        
        inner_points.append(rg.Point3d(mesh.Vertices[i]))

    local_edges = []
    for i in range(len(face.indexes)):
        
        v1 = i
        v2 = (i + 1) % len(face.indexes)
        
        key = Edge.generate_key(face.indexes[v1], face.indexes[v2])
        
        local_edges.append(edges[key])
    
    m = rg.Mesh()
    
    for p in inner_points + outer_points:
        
        m.Vertices.Add(p.X, p.Y, p.Z)

    m.Faces.AddFace(0, 1, 2)
    m.Faces.AddFace(3, 4, 5)
    
    loop_sets = zip([0, 1, 2], [[0, 1, 4, 3], [1, 2, 5, 4], [2, 0, 3, 5]])

    for edge_index, original_indexes in loop_sets:
    
        edge = local_edges[edge_index]
    
        if len(edge.faces) != 2:
            
            m.Faces.AddFace(original_indexes[0], original_indexes[1], original_indexes[2], original_indexes[3])
        
        elif joint_type == 0:
            
            m.Faces.AddFace(original_indexes[0], original_indexes[1], original_indexes[2], original_indexes[3])
        
        elif joint_type == 1:
            
            p0 = rg.Vector3d(m.Vertices[original_indexes[0]])
            p1 = rg.Vector3d(m.Vertices[original_indexes[1]])
            p2 = rg.Vector3d(m.Vertices[original_indexes[2]])
            p3 = rg.Vector3d(m.Vertices[original_indexes[3]])
            
            vec1 = rg.Vector3d(p1) - rg.Vector3d(p0)
            vec2 = rg.Vector3d(p3) - rg.Vector3d(p0)
            vec3 = rg.Vector3d(p2) - rg.Vector3d(p1)
            
            normal = rg.Vector3d.CrossProduct(vec1, vec2)
            normal.Unitize()

            if not edge.male_created:
                
                alpha = 1
                beta  = 0.36
                gamma = 0.64
                zeta  = 0.5
                
            else:
                
                alpha = -1
                beta  = 0.35
                gamma = 0.65
                zeta  = 0.5
                
            normal *= joint_length
            p4 = p0 + vec1 * beta
            p5 = p0 + vec1 * gamma
            p6 = (p5 + p4) * zeta + (vec2 * 0.25 + vec3 * 0.25)
            p7  = p4 + normal
            p8  = p5 + normal
            p9  = p6 + normal
    
            p10 = p0 + vec2 * zeta
            p11 = p1 + vec3 * zeta
            
            current_length = len(m.Vertices) - 1
    
            m.Vertices.Add(p4.X, p4.Y, p4.Z) # 1
            m.Vertices.Add(p5.X, p5.Y, p5.Z) # 2
            m.Vertices.Add(p6.X, p6.Y, p6.Z) # 3
            m.Vertices.Add(p7.X, p7.Y, p7.Z) # 4
            m.Vertices.Add(p8.X, p8.Y, p8.Z) # 5
            m.Vertices.Add(p9.X, p9.Y, p9.Z) # 6
            m.Vertices.Add(p10.X, p10.Y, p10.Z) # 8
            m.Vertices.Add(p11.X, p11.Y, p11.Z) # 7
            
            m.Faces.AddFace(original_indexes[0], current_length + 1, current_length + 3, current_length + 7)
            m.Faces.AddFace(original_indexes[1], current_length + 8, current_length + 3, current_length + 2)
            m.Faces.AddFace(original_indexes[2], original_indexes[3], current_length + 7, current_length + 8)
            m.Faces.AddFace(current_length + 4, current_length + 5, current_length + 6)
            m.Faces.AddFace(current_length + 1, current_length + 2, current_length + 5, current_length + 4)
            m.Faces.AddFace(current_length + 2, current_length + 3, current_length + 6, current_length + 5)
            m.Faces.AddFace(current_length + 3, current_length + 1, current_length + 4, current_length + 6)
            
            if not edge.male_created:
                edge.male_created = True

        elif joint_type == 2:
            
            p0 = rg.Vector3d(m.Vertices[original_indexes[0]])
            p1 = rg.Vector3d(m.Vertices[original_indexes[1]])
            p2 = rg.Vector3d(m.Vertices[original_indexes[2]])
            p3 = rg.Vector3d(m.Vertices[original_indexes[3]])
            
            vec1 = rg.Vector3d(p1) - rg.Vector3d(p0)
            vec2 = rg.Vector3d(p3) - rg.Vector3d(p0)
            vec3 = rg.Vector3d(p2) - rg.Vector3d(p1)
            
            normal = rg.Vector3d.CrossProduct(vec1, vec2)
            normal.Unitize()

            if not edge.male_created:
                
                alpha = joint_length * 0.9
                beta  = joint_width * 0.45
                gamma = joint_width * 0.45
                zeta  = joint_width * 0.45
                
            else:
                
                alpha = -joint_length
                beta  = joint_width * 0.5
                gamma = joint_width * 0.5
                zeta  = joint_width * 0.5
                
            
            unit_vec1 = rg.Vector3d(vec1)
            unit_vec1.Unitize()
            unit_vec1 *= 1

            unit_vec2 = rg.Vector3d(vec2)
            unit_vec2.Unitize()
            unit_vec2 *= 1
            
            unit_vec3 = rg.Vector3d(vec3)
            unit_vec3.Unitize()
            unit_vec3 *= 1
            
            normal *= alpha
            
            horizontal_middle = vec1 * 0.5
            vertical_middle = (vec2 + vec3) * 0.25
            vertical_unit = (unit_vec2 + unit_vec3) * 0.5
            vertical_unit.Unitize()
            p4 = p0 + horizontal_middle - unit_vec1 * beta + vertical_middle - vertical_unit * gamma
            p5 = p0 + horizontal_middle + unit_vec1 * beta + vertical_middle - vertical_unit * gamma
            p7 = p0 + horizontal_middle - unit_vec1 * beta + vertical_middle + vertical_unit * zeta
            p6 = p0 + horizontal_middle + unit_vec1 * beta + vertical_middle + vertical_unit * zeta
            p8   = p4 + normal
            p9   = p5 + normal
            p10  = p6 + normal
            p11  = p7 + normal
            
            current_length = len(m.Vertices) - 1
            
            m.Vertices.Add(p4.X, p4.Y, p4.Z) # 1
            m.Vertices.Add(p5.X, p5.Y, p5.Z) # 2
            m.Vertices.Add(p6.X, p6.Y, p6.Z) # 3
            m.Vertices.Add(p7.X, p7.Y, p7.Z) # 4
            m.Vertices.Add(p8.X, p8.Y, p8.Z) # 5
            m.Vertices.Add(p9.X, p9.Y, p9.Z) # 6
            m.Vertices.Add(p10.X, p10.Y, p10.Z) # 7
            m.Vertices.Add(p11.X, p11.Y, p11.Z) # 8
            
            m.Faces.AddFace(original_indexes[0], original_indexes[1], current_length + 2, current_length + 1)
            m.Faces.AddFace(original_indexes[0], current_length + 1, current_length + 4, original_indexes[3])
            m.Faces.AddFace(original_indexes[1], original_indexes[2], current_length + 3, current_length + 2)
            m.Faces.AddFace(original_indexes[2], original_indexes[3], current_length + 4, current_length + 3)
            
            m.Faces.AddFace(current_length + 5, current_length + 6, current_length + 7, current_length + 8)
            m.Faces.AddFace(current_length + 1, current_length + 2, current_length + 6, current_length + 5)
            m.Faces.AddFace(current_length + 2, current_length + 3, current_length + 7, current_length + 6)
            m.Faces.AddFace(current_length + 3, current_length + 4, current_length + 8, current_length + 7)
            m.Faces.AddFace(current_length + 4, current_length + 1, current_length + 5, current_length + 8)

            if not edge.male_created:
                edge.male_created = True
            
        else:
            
            raise ValueError('No Joint type!')

    m2 = rg.Mesh()
    rg.Mesh.CopyFrom(m2, m)
    rigid_faces.append(m)
    oriented_rigid_faces.append(m2)
    
    # get a base plane
    
    outer_points += [outer_points[0]]
    outer_curve = rg.PolylineCurve(outer_points)

    inner_vec1 = rg.Vector3d(inner_points[1]) - rg.Vector3d(inner_points[0])
    inner_vec2 = rg.Vector3d(inner_points[2]) - rg.Vector3d(inner_points[0])
    
    outer_vec1 = rg.Vector3d(outer_points[1]) - rg.Vector3d(outer_points[0])
    outer_vec2 = rg.Vector3d(outer_points[2]) - rg.Vector3d(outer_points[0])
    
    inner_area = rg.Vector3d.CrossProduct(inner_vec1, inner_vec2).Length
    outer_area = rg.Vector3d.CrossProduct(outer_vec1, outer_vec2).Length

    if inner_area > outer_area:

        use_inner = True
        points = inner_points
    
    else:
        
        use_inner = False
        points = outer_points[:-1]
    
    cx, cy, cz = 0, 0, 0
    
    for p in points:
        
        cx += p.X
        cy += p.Y
        cz += p.Z
    
    cx /= 3
    cy /= 3
    cz /= 3
    
    center = rg.Point3d(cx, cy, cz)
    
    vector1 = rg.Vector3d(points[1]) - rg.Vector3d(points[0])
    vector2 = rg.Vector3d(points[2]) - rg.Vector3d(points[0])

    vector1.Unitize()
    vector2.Unitize()
    
    normal = rg.Vector3d.CrossProduct(vector1, vector2)
    normal.Unitize()
    
    base_plane = rg.Plane(center, normal)
    base_planes.append(base_plane)

    if not use_inner:
        base_plane.Flip()
    tmp.append(base_plane)

i = 0

rows = math.sqrt(len(oriented_rigid_faces))

for base_plane, face in zip(base_planes, oriented_rigid_faces):
    
    transform = rg.Transform.PlaneToPlane(base_plane, rg.Plane.WorldXY)
    
    face.Transform(transform)
    
    dx = interval * (i % rows)
    dy = interval * (i / rows)
    
    transform = rg.Transform.Translation(origin.X + dx, origin.Y + dy, origin.Z)
    
    face.Transform(transform)
    
    i += 1
# ---------- end python_10 ----------
